% Simulink data dictionary Current_Control_interface.sldd

CurrentControl_in = Simulink.Bus()
  reference: single
  measurement: single
  enable: uint16
  slewrate: single[2]

CurrentControl_out = Simulink.Bus()
  ctrlOut: single
  isAtSetpoint: uint16
  rampedSetpoint: single

CurrentControl_ts = 0.0001