% Simulink data dictionary Voltage_Control.sldd
% references configuration.sldd

VoltageControl_out = Simulink.Bus()
  ctrlOut: single
  isAtSetpoint: uint16
  rampedSetpoint: single

VoltageControl_ts = 0.0001
VoltageControl_min = 0
VoltageControl_max = 15

VoltageControl_in = Simulink.Bus()
  reference: single
  measurement: single
  enable: uint16
  slewrate: single[2]
  opmode: uint16
  openLoopSetpoint: single