% Simulink data dictionary common.sldd

CurrentControl_in = Simulink.Bus()
  reference: single
  measurement: single
  enable: uint16
  slewrate: single[2]

CurrentControl_out = Simulink.Bus()
  ctrlOut: single
  isAtSetpoint: uint16
  rampedSetpoint: single

CurrentControl_ts = 0.0001
CurrentControl_min = 0
CurrentControl_max = 15
CpuOne = Simulink.ConfigSet(StartTime="0", StopTime="10", Solver="FixedStepAuto", ProdHWDeviceType="Texas Instruments->C2000", SystemTargetFile="ert.tlc", HardwareBoard="TI Delfino F2837xD", TargetLang="C")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
CpuTwo = Simulink.ConfigSet(StartTime="0", StopTime="10", Solver="FixedStepAuto", ProdHWDeviceType="Texas Instruments->C2000", SystemTargetFile="ert.tlc", HardwareBoard="TI Delfino F2837xD", TargetLang="C")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