% Simulink data dictionary ipc.sldd

com2ctrl = Simulink.Bus()
  voltageSetpoint: single
  enable: uint16
  opmode: uint16
  currentSetpoint: single

ctrl2com = Simulink.Bus()
  voltageMeasured: single
  currentMeasured: single
  status: uint16